# Grasshopper definition countStones.gh (Grasshopper 1.0.7)

crv = Curve(<curve referenced from the Rhino model>)
len = Length(Curve=crv)
end = EndPoints(Curve=crv)  # -> Start, End
vec2pt = Vector2Pt(PointA=end.Start, PointB=end.End, Unitize=True)  # -> Vector, Length
vlen = VectorLength(Vector=vec2pt.Vector)
pt = Point(<point referenced from the Rhino model>)
python = GhPythonScript(x=Slider(46, range=20..60), y=Slider(125, range=90..130), z=Slider(5, range=0..5))  # -> out, a; inputs x: Int32
# ---------- python: Python ----------
__author__ = "dimi"
__version__ = "2022.08.20"

import rhinoscriptsyntax as rs
a=[0]
count=0.0
for i in range(x):
    print y - count
    a.append(a[i]+y - count)
    count+=z
# ---------- end python ----------
multiplication = Multiplication(A=vec2pt.Vector, B=python.a)
move = Move(Geometry=pt, Motion=multiplication)  # -> Geometry, Transform
panel = Panel(python.a)
