# Grasshopper definition concept1.gh (Grasshopper 1.0.7)

mesh = Mesh(<mesh referenced from the Rhino model>)
gradient = Gradient(
    LowerLimit=0,
    UpperLimit=1,
    stops=[0: RGB(234, 38, 0), 0.25: RGB(234, 126, 0), 0.5: RGB(254, 244, 84), 0.75: RGB(173, 203, 249), 1: RGB(75, 107, 169)])
custom_preview = CustomPreview(Geometry=mesh, Material=ColourSwatch(SwatchColor=RGB(219, 48, 48)))
ahsl = SplitAHSL(Colour=gradient)  # -> Alpha, Hue, Saturation, Luminance
hsl = ColourHSL(Alpha=0.6, Hue=ahsl.Hue, Saturation=ahsl.Saturation, Luminance=ahsl.Luminance)
