# Grasshopper definition roof_concept.gh (Grasshopper 1.0.7)

number_slider = Slider(20, range=0..100)
crv = Curve(<curve referenced from the Rhino model>)
crv_2 = Curve(<curve referenced from the Rhino model>)
crv_3 = Curve(<curve referenced from the Rhino model>)
crv_4 = Curve(<curve referenced from the Rhino model>)
crv_5 = Curve(<curve referenced from the Rhino model>)
divide = DivideCurve(Curve=crv_4, Count=number_slider, Kinks=False)  # -> Points, Tangents, Parameters
divide_2 = DivideCurve(Curve=crv_2, Count=number_slider, Kinks=False)  # -> Points, Tangents, Parameters
divide_3 = DivideCurve(Curve=crv, Count=number_slider, Kinks=False)  # -> Points, Tangents, Parameters
divide_4 = DivideCurve(Curve=crv_3, Count=number_slider, Kinks=False)  # -> Points, Tangents, Parameters
divide_5 = DivideCurve(Curve=crv_5, Count=number_slider, Kinks=False)  # -> Points, Tangents, Parameters
ln = Line(StartPoint=divide.Points, EndPoint=divide_2.Points)
ln_2 = Line(StartPoint=divide.Points, EndPoint=divide_3.Points)
ln_3 = Line(StartPoint=divide_3.Points, EndPoint=divide_4.Points)
ln_4 = Line(StartPoint=divide_2.Points, EndPoint=divide_5.Points)
ln_5 = Line(StartPoint=divide_4.Points, EndPoint=divide_5.Points)
loft = Loft(Curves=ln, Options={Adjust=False, Closed=False, LoftEnds=0, LoftSimp=0, LoftType=0, Rebuild=10, Refit=0.01})
loft_2 = Loft(Curves=ln_2, Options={Adjust=False, Closed=False, LoftEnds=0, LoftSimp=0, LoftType=0, Rebuild=10, Refit=0.01})
loft_3 = Loft(Curves=ln_4, Options={Adjust=False, Closed=False, LoftEnds=0, LoftSimp=0, LoftType=0, Rebuild=10, Refit=0.01})
loft_4 = Loft(Curves=ln_3, Options={Adjust=False, Closed=False, LoftEnds=0, LoftSimp=0, LoftType=0, Rebuild=10, Refit=0.01})
loft_5 = Loft(Curves=ln_5, Options={Adjust=False, Closed=False, LoftEnds=0, LoftSimp=0, LoftType=0, Rebuild=10, Refit=0.01})
material = CreateMaterial(
    Diffuse=ColourSwatch(SwatchColor=RGB(52, 47, 97)),
    Specular=RGB(255, 255, 255),
    Emission=RGB(0, 0, 0),
    Transparency=Slider(0.3, range=0..1),
    Shine=0)
preview = CustomPreview(Geometry=[loft_2, loft_4, loft, loft_3], Material=material)
