# Grasshopper definition test.gh (Grasshopper 0.9.76)
# plug-ins: Weaverbird, RhinoInUtility

number_slider = Slider(4, range=2..20)
crv = Curve([<curve referenced from the Rhino model> x2])
crv_2 = Curve([<curve referenced from the Rhino model> x2])
dispatch = Dispatch(List=crv, DispatchPattern=[True, False])  # -> ListA, ListB
dispatch_2 = Dispatch(List=crv_2, DispatchPattern=[True, False])  # -> ListA, ListB
divide = DivideCurve(Curve=dispatch.ListA, Count=number_slider, Kinks=False)  # -> Points, Tangents, Parameters
divide_2 = DivideCurve(Curve=dispatch.ListB, Count=number_slider, Kinks=number_slider)  # -> Points, Tangents, Parameters
divide_3 = DivideCurve(Curve=dispatch_2.ListB, Count=number_slider, Kinks=False)  # -> Points, Tangents, Parameters
divide_4 = DivideCurve(Curve=dispatch_2.ListA, Count=number_slider, Kinks=False)  # -> Points, Tangents, Parameters
rev = ReverseList(List=divide_3.Points)
rev_2 = ReverseList(List=divide.Points)
rev_3 = ReverseList(List=divide_2.Points)
mesh = Mesh(<mesh referenced from the Rhino model>)
yz = YZPlane(Origin=Point(0, 0, 0))
mesh_2 = Mesh([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])
mesh_3 = Mesh([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])
ln = Line(StartPoint=divide.Points, EndPoint=rev_3)
ln_2 = Line(StartPoint=divide_4.Points, EndPoint=rev)
ln_3 = Line(StartPoint=divide_4.Points, EndPoint=rev_2)
mirror = Mirror(Geometry=mesh, Plane=yz)  # -> Geometry, Transform
ln_4 = Line(StartPoint=rev, EndPoint=divide_2.Points)
mesh_4 = Mesh([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])
wbjoin = WeaverbirdsJoinMeshesAndWeld(Mesh=[mesh, mirror.Geometry], Weld=False)
fsp = FindSamePoints(Points=[divide.Points, divide_4.Points, divide_3.Points, divide_2.Points])  # -> UniquePoints, Output
mesh_5 = Mesh(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)
crv_3 = Curve(flatten([ln_2, ln_3, ln_4, ln]))
mesh_6 = Mesh(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)
fsl = FindSameLines(Lines=crv_3)  # -> UniqueLines, Output
pdecon = Deconstruct(Point=Point(12, 0, 7.7))  # -> XComponent, YComponent, ZComponent
pdecon_2 = Deconstruct(Point=fsp.UniquePoints)  # -> XComponent, YComponent, ZComponent
wbcatmullclark = WeaverbirdsCatmullClarkSubdivision(MeshCurves=wbjoin, Level=Slider(3, range=0..10), SmoothNakedEdges=1)
len = Length(Curve=fsl.UniqueLines)
pt = ConstructPoint(XCoordinate=pdecon_2.XComponent, YCoordinate=pdecon_2.YComponent, ZCoordinate=pdecon.ZComponent)
wbnaked = WeaverbirdsNakedBoundary(MeshClosedPolylines=wbcatmullclark)
sort = SortList(Keys=len, ValuesA=fsl.UniqueLines)  # -> Keys, ValuesA
larger = LargerThan(FirstNumber=sort.Keys, SecondNumber=0.1)  # -> LargerThan, OrEqualTo
panel = Panel(wbnaked)
dispatch_3 = Dispatch(List=sort.ValuesA, DispatchPattern=larger.LargerThan)  # -> ListA, ListB
pline = PolyLine(Vertices=divide_3.Points, Closed=False)
pline_2 = PolyLine(Vertices=divide.Points, Closed=False)
pline_3 = PolyLine(Vertices=divide_2.Points, Closed=False)
pline_4 = PolyLine(Vertices=divide_4.Points, Closed=False)
crv_4 = Curve(dispatch_3.ListA)
ln_5 = Line(StartPoint=fsp.UniquePoints, EndPoint=pt)
panel_2 = Panel(sort.Keys)
