# Grasshopper definition treppe-golm.gh (Grasshopper 1.0.7)

number_slider = Slider(80, range=0..100)
crv = Curve(<curve referenced from the Rhino model>)
divide = DivideCurve(Curve=crv, Count=number_slider, Kinks=False)  # -> Points, Tangents, Parameters
devec = DeconstructVector(Vector=divide.Tangents)  # -> XComponent, YComponent, ZComponent
Z = UnitZ(Factor=1)
vec = VectorXYZ(XComponent=devec.XComponent, YComponent=devec.YComponent, ZComponent=0)  # -> Vector, Length
unit = UnitVector(Vector=vec.Vector)
xprod = CrossProduct(VectorA=divide.Tangents, VectorB=Z, Unitize=False)  # -> Vector, Length
series = Series(Start=Slider(0, range=0..10), Step=Slider(0.1, range=0..1), Count=expr("(x+1)/2", number_slider))
dprod = DotProduct(VectorA=divide.Tangents, VectorB=Z, Unitize=False)
multiplication = Multiplication(A=unit, B=Slider(0.5, range=0..1))
rev = ReverseList(List=series)
Z_2 = UnitZ(Factor=0.05)
data = Data([series, rev])
line = LineSDL(Start=divide.Points, Direction=xprod.Vector, Length=data)
extr = Extrude(Base=line, Direction=multiplication)
graph = GraphMapper(series, x0=0, x1=1, y0=0, y1=1, container_name="Sine", Equation_px=[0, 0.4503154755], Equation_py=[0, 0.6625888348])
extr_2 = Extrude(Base=extr, Direction=Z_2)
division = Division(A=graph, B=10)
panel = Panel(graph)
