# Grasshopper definition tensdimi.gh (Grasshopper 1.0.7)
# plug-ins: Kangaroo2 Components

number_slider = Slider(4, range=0..10)
pt = ConstructPoint(XCoordinate=0, YCoordinate=0, ZCoordinate=0)
pt_2 = ConstructPoint(XCoordinate=0, YCoordinate=0, ZCoordinate=Slider(13, range=0..30))
cir = Circle(Plane=pt, Radius=number_slider)
cir_2 = Circle(Plane=pt_2, Radius=number_slider)
number_slider_2 = Slider(6, range=0..10)
divide = DivideCurve(Curve=cir_2, Count=number_slider_2, Kinks=False)  # -> Points, Tangents, Parameters
divide_2 = DivideCurve(Curve=cir, Count=number_slider_2, Kinks=False)  # -> Points, Tangents, Parameters
shift = ShiftList(List=divide_2.Points, Shift=1, Wrap=True)
pline = PolyLine(Vertices=divide.Points, Closed=True)
pline_2 = PolyLine(Vertices=divide_2.Points, Closed=True)
ln = Line(StartPoint=divide.Points, EndPoint=divide_2.Points)
explode = Explode(Curve=[pline, pline_2], Recursive=True)  # -> flatten(Segments), Vertices
zug = Line(flatten([explode.Segments, ln]))
druck = Line(StartPoint=divide.Points, EndPoint=shift)
zug_2 = Curve(zug)
druck_2 = Curve(druck)
len = Length(Curve=zug_2)
division = Division(A=len, B=2)
end = EndPoints(Curve=druck_2)  # -> Start, End
vec = VectorXYZ(XComponent=0, YComponent=0, ZComponent=Slider(-1, range=-2..1))  # -> Vector, Length
length_line = LengthLine(Line=druck_2, Length=druck_2, Strength=10)
length_line_2 = LengthLine(Line=zug_2, Length=division, Strength=10)
load = Load(Point=flatten([end.Start, end.End]), ForceVector=vec.Vector, Weighting=1)
floor = Floor(Strength=Slider(10, range=0..10))
solver = Solver(GoalObjects=flatten([length_line, length_line_2, floor, load]), Reset=Button(), Threshold=1e-15, Tolerance=0.01, On=True)  # -> I, V, O
clean = CleanTree(RemoveNulls=True, RemoveInvalid=True, RemoveEmpty=False, Tree=solver.O)
len_2 = Length(Curve=clean)
sort = SortList(Keys=len_2, ValuesA=clean)  # -> Keys, ValuesA
panel = Panel(solver.O)
rev = ReverseList(List=sort.ValuesA)
split = SplitList(List=rev, Index=number_slider_2)  # -> ListA, ListB
pipe = Pipe(Curve=split.ListA, Radius=Slider(0.2, range=0..1), Caps=1)
pipe_2 = Pipe(Curve=split.ListB, Radius=Slider(0.03, range=0..1), Caps=1)
preview = CustomPreview(Geometry=pipe_2, Material=ColourSwatch(SwatchColor=RGB(0, 144, 255)))
