# Grasshopper definition tensdimi2.gh (Grasshopper 1.0.7)
# plug-ins: Kangaroo2 Components

pt = ConstructPoint(XCoordinate=0, YCoordinate=0, ZCoordinate=0)
pt_2 = ConstructPoint(XCoordinate=0, YCoordinate=0, ZCoordinate=Slider(21, range=0..30))
cir = Circle(Plane=pt, Radius=Slider(10, range=0..10))
cir_2 = Circle(Plane=pt_2, Radius=Slider(1, range=0..10))
div = DivideDomain(Domain=Domain(0, 1), Count=10)
vec = VectorXYZ(XComponent=0, YComponent=0, ZComponent=Slider(-1, range=-2..1))  # -> Vector, Length
number_slider = Slider(13, range=0..20)
divide = DivideCurve(Curve=cir_2, Count=number_slider, Kinks=False)  # -> Points, Tangents, Parameters
divide_2 = DivideCurve(Curve=cir, Count=number_slider, Kinks=False)  # -> Points, Tangents, Parameters
shift = ShiftList(List=divide_2.Points, Shift=1, Wrap=True)
pline = PolyLine(Vertices=divide.Points, Closed=True)
pline_2 = PolyLine(Vertices=divide_2.Points, Closed=True)
ln = Line(StartPoint=divide.Points, EndPoint=divide_2.Points)
explode = Explode(Curve=[pline, pline_2], Recursive=True)  # -> flatten(Segments), Vertices
druck = Line(StartPoint=divide.Points, EndPoint=shift)
zug = Line(flatten([explode.Segments, ln]))
crv = Curve(reparameterize(graft(zug)))
subcrv = SubCurve(BaseCurve=crv, Domain=div)  # -> flatten(Curve)
druck_2 = Curve(druck)
end = EndPoints(Curve=druck_2)  # -> Start, End
zug_2 = Curve(zug)
len = Length(Curve=zug_2)
division = Division(A=len, B=2)
length_line = LengthLine(Line=druck_2, Length=druck_2, Strength=10)
length_line_2 = LengthLine(Line=zug_2, Length=division, Strength=10)
load = Load(Point=flatten([end.Start, end.End]), ForceVector=vec.Vector, Weighting=1)
floor = Floor(Strength=Slider(10, range=0..10))
solver = Solver(
    GoalObjects=flatten([length_line, length_line_2, floor, load]),
    Reset=Button(),
    Threshold=1e-15,
    Tolerance=0.01,
    On=Toggle(True))  # -> I, V, O
clean = CleanTree(RemoveNulls=True, RemoveInvalid=True, RemoveEmpty=False, Tree=solver.O)
len_2 = Length(Curve=clean)
sort = SortList(Keys=len_2, ValuesA=clean)  # -> Keys, ValuesA
rev = ReverseList(List=sort.ValuesA)
split = SplitList(List=rev, Index=number_slider)  # -> ListA, ListB
panel = Panel(split.ListA)
pipe = Pipe(Curve=split.ListA, Radius=Slider(0.1, range=0..1), Caps=1)
pipe_2 = Pipe(Curve=split.ListB, Radius=Slider(0.03, range=0..1), Caps=1)
preview = CustomPreview(Geometry=pipe_2, Material=ColourSwatch(SwatchColor=RGB(0, 144, 255)))
